# Grasshopper definition objects_script.gh (Grasshopper 1.0.7)
# plug-ins: DigitalCircularityToolkit, Human

number_slider = Slider(20, range=0..20)
mesh = Mesh(<mesh referenced from the Rhino model>)
brep = Brep(<brep referenced from the Rhino model>)
crv = Curve(<curve referenced from the Rhino model>)
popgeo = PopulateGeometry(Geometry=brep, Count=100, Seed=1)
obj = Object_GH(Geometry=mesh, NumSamples=50)
X = UnitX(Factor=Slider(391, range=0..2000))
objinfo = ObjectInformation(Object=obj)  # -> Centroid, PCA1, PCA2, PCA3, Length, Width, Height, BoundingBox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
move = Move(Geometry=popgeo, Motion=X)  # -> Geometry, Transform
ptcloud = PointCloud(Points=move.Geometry)
geo = Geometry(objinfo.AlignedGeometry)
multiplication = Multiplication(A=objinfo.Length, B=Slider(0.6, range=0..1))
line = LineSDL(Start=objinfo.Centroid, Direction=objinfo.PCA1, Length=multiplication)
line_2 = LineSDL(Start=objinfo.Centroid, Direction=objinfo.PCA2, Length=multiplication)
line_3 = LineSDL(Start=objinfo.Centroid, Direction=objinfo.PCA3, Length=multiplication)
preview = CustomPreview(Geometry=geo, Material=ColourSwatch(SwatchColor=RGBA(187, 255, 105, 137)))
number_slider_2 = Slider(4, range=1..4)
previewlw = CustomPreviewLineweights(Geometry=line, Shader=ColourSwatch(SwatchColor=RGB(250, 0, 0)), Thickness=number_slider_2, Absolute=False)
previewlw_2 = CustomPreviewLineweights(Geometry=line_2, Shader=ColourSwatch(SwatchColor=RGB(0, 54, 250)), Thickness=number_slider_2, Absolute=False)
previewlw_3 = CustomPreviewLineweights(Geometry=line_3, Shader=ColourSwatch(SwatchColor=RGB(0, 250, 21)), Thickness=number_slider_2, Absolute=False)
