# Grasshopper definition radialsig_script.gh (Grasshopper 1.0.7)
# plug-ins: DigitalCircularityToolkit

pt = Point([<point referenced from the Rhino model> x1240])
mesh = Mesh([<mesh referenced from the Rhino model> x65])
pointcloud = ToPointCloud(Points=pt)
brep = Brep([<brep referenced from the Rhino model> x2])
crv = Curve([<curve referenced from the Rhino model> x2])
obj = Object(Geometry=crv, NumSamples=50)
objprops = ObjectProperties(Object=obj)  # -> Centroid, PCA1, PCA2, PCA3, Length, Width, Height, BoundingBox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
crv_2 = Curve(objprops.PlanarHull)
radialsig = RadialSignature(Curve=crv_2, NumSamples=Slider(52, range=20..100))  # -> Signature, Centroid
graph = QuickGraph(radialsig.Signature, SortOrder=0)
